# Grasshopper definition Assignment01_LucasSentis.gh (Grasshopper 1.0.7)

hor_fin_num_x_floor = Slider(3, range=0..7)
hor_fin_angle_1 = Slider(9, range=0..60)
hor_fin_angle_2 = Slider(0, range=0..60)
hor_fin_depth = Slider(0.6, range=0..1)

floor_height_gf = Slider(6, range=3..12)
floor_height_typ = Slider(4.5, range=3..12)
num_of_floors = Slider(20, range=0..100)
# Circular Skyscraper
crown_height = Slider(9, range=3..12)

floor_plan_bottom_rad = Slider(8, range=5..25)
floor_plan_mid_rad = Slider(10, range=5..15)
floor_plan_top_rad = Slider(7, range=5..25)

crown_height_2 = GetNumber(crown_height, AtLeast=1, AtMost=1, Maximum=1.797693135e+308, Minimum=-1.797693135e+308, TreeAccess=False)
floor_height_typ_2 = GetNumber(floor_height_typ, AtLeast=1, AtMost=1, Maximum=1.797693135e+308, Minimum=-1.797693135e+308, TreeAccess=False)
floor_height_gf_2 = GetNumber(floor_height_gf, AtLeast=1, AtMost=1, Maximum=1.797693135e+308, Minimum=-1.797693135e+308, TreeAccess=False)
num_of_floors_2 = GetInteger(num_of_floors, AtLeast=1, AtMost=1, Maximum=2147483647, Minimum=-2147483648, TreeAccess=False)
floor_plan_bottom_rad_2 = GetInteger(floor_plan_bottom_rad, AtLeast=1, AtMost=1, Maximum=2147483647, Minimum=-2147483648, TreeAccess=False)
floor_plan_mid_rad_2 = GetInteger(floor_plan_mid_rad, AtLeast=1, AtMost=1, Maximum=2147483647, Minimum=-2147483648, TreeAccess=False)
floor_plan_top_rad_2 = GetInteger(floor_plan_top_rad, AtLeast=1, AtMost=1, Maximum=2147483647, Minimum=-2147483648, TreeAccess=False)
hor_fin_num_x_floor_2 = GetInteger(hor_fin_num_x_floor, AtLeast=1, AtMost=1, Maximum=2147483647, Minimum=-2147483648, TreeAccess=False)
hor_fin_angle_1_2 = GetInteger(hor_fin_angle_1, AtLeast=1, AtMost=1, Maximum=2147483647, Minimum=-2147483648, TreeAccess=False)
hor_fin_angle_2_2 = GetInteger(hor_fin_angle_2, AtLeast=1, AtMost=1, Maximum=2147483647, Minimum=-2147483648, TreeAccess=False)
hor_fin_depth_2 = GetNumber(hor_fin_depth, AtLeast=1, AtMost=1, Maximum=1.797693135e+308, Minimum=-1.797693135e+308, TreeAccess=False)
Z = UnitZ(Factor=crown_height_2)

# ----
# Tower massing
pt = ConstructPoint(XCoordinate=0, YCoordinate=0, ZCoordinate=0)
series = Series(Start=floor_height_gf_2, Step=floor_height_typ_2, Count=num_of_floors_2)
Z_2 = UnitZ(Factor=series)
move = Move(Geometry=pt, Motion=Z_2)  # -> Geometry, Transform
item = ListItem(List=move.Geometry, Index="-1", Wrap=True)
entwine = Entwine(Branch00=floor_plan_bottom_rad_2, Branch01=floor_plan_mid_rad_2, Branch02=floor_plan_top_rad_2, FlattenInputs=True)

# ----
# No of Horizontal Fins x Floor
division = Division(A=floor_height_typ_2, B=hor_fin_num_x_floor_2)
series_2 = Series(Start=0, Step=division, Count=hor_fin_num_x_floor_2)
pt_2 = Point(graft(move.Geometry))
Z_3 = UnitZ(Factor=series_2)
move_2 = Move(Geometry=pt_2, Motion=Z_3)  # -> flatten(Geometry), Transform
lng = ListLength(List=move_2.Geometry)

# ----
# Horizontal Fin Inclination
dom = ConstructDomain(DomainStart=hor_fin_angle_1_2, DomainEnd=hor_fin_angle_2_2)
random = Random(Range=dom, Number=lng, Seed=2)
X = UnitX(Factor=1)
Z_4 = UnitZ(Factor=1)
xy = XYPlane(Origin=Point(0, 0, 0))
int = Integer(random)
pl_origin = PlaneOrigin(Base=xy, Origin=move_2.Geometry)
vrot = Rotate(Vector=X, Axis=Z_4, Angle=int)
vec = Vector(pl_origin)
prot = RotatePlane(Plane=pl_origin, Angle=degrees(int))
vrot_2 = Rotate(Vector=vec, Axis=vrot, Angle=degrees(int))
padjust = AdjustPlane(Plane=prot, Normal=vrot_2)

move_3 = Move(Geometry=item, Motion=Z)  # -> Geometry, Transform

ln = Line(StartPoint=pt, EndPoint=move_3.Geometry)
midpt = CurveMiddle(Curve=ln)
entwine_2 = Entwine(Branch00=pt, Branch01=midpt, Branch02=move_3.Geometry, FlattenInputs=True)
cir = Circle(Plane=entwine_2, Radius=entwine)
loft = Loft(Curves=flatten(cir), Options={Adjust=False, Closed=False, LoftEnds=0, LoftSimp=0, LoftType=0, Rebuild=10, Refit=0.01})

# ----
# CW Mullion
item_2 = ListItem(List=flatten(cir), Index=0, Wrap=True)
len = Length(Curve=item_2)
division_2 = Division(A=len, B="1.5")
int_2 = Integer(division_2)
divide = DivideCurve(Curve=cir, Count=int_2, Kinks=False)  # -> Points, Tangents, Parameters
flip = FlipMatrix(Data=divide.Points)
srf_cp = SurfaceClosestPoint(Point=flip, Surface=loft)  # -> Point, UVPoint, Distance
crvsrf = CurveOnSurface(Surface=loft, UVCoordinates=srf_cp.UVPoint, Closed=False)  # -> Curve, Length, Domain

# ----
# Horizontal Fin Profile
sec = BrepPlane(Brep=loft, Plane=padjust)  # -> Curves, Points
offset = OffsetCurve(Curve=sec.Curves, Distance=hor_fin_depth_2, Corners=1)
rulesrf = RuledSurface(CurveA=offset, CurveB=sec.Curves)

# ----
# CW Transom
panel = Panel("-1.5")
Z_5 = UnitZ(Factor=panel)
move_4 = Move(Geometry=move.Geometry, Motion=Z_5)  # -> Geometry, Transform
sec_2 = BrepPlane(Brep=loft, Plane=[move.Geometry, move_4.Geometry])  # -> Curves, Points

pipe = Pipe(Curve=[sec_2.Curves, crvsrf.Curve], Radius=Slider(0.05, range=0..0.1), Caps=0)
mcol = MeshColours(Mesh=loft, Colours=ColourSwatch(SwatchColor=RGBA(125, 171, 184, 95)))
mcol_2 = MeshColours(Mesh=pipe, Colours=ColourSwatch(SwatchColor=RGB(51, 51, 51)))
mcol_3 = MeshColours(Mesh=rulesrf, Colours=ColourSwatch(SwatchColor=RGB(33, 0, 250)))

# ---- group: RH_OUT:GlassFacade
geo = Geometry(mcol)

# ---- group: RH_OUT:Mullion
geo_2 = Geometry(mcol_2)

# ---- group: RH_OUT:Fin
geo_3 = Geometry(mcol_3)
